# Grasshopper definition arrayed_bench.gh (Grasshopper 1.0.7)

pt = ConstructPoint(XCoordinate=Slider(5, range=0..20), YCoordinate=Slider(0, range=0..10), ZCoordinate=Slider(10, range=0..20))
pt_2 = ConstructPoint(XCoordinate=Slider(15, range=0..20), YCoordinate=Slider(0, range=0..10), ZCoordinate=Slider(8, range=0..20))
pt_3 = ConstructPoint(XCoordinate=Slider(20, range=0..20), YCoordinate=Slider(0, range=0..10), ZCoordinate=Slider(20, range=0..20))
pt_4 = ConstructPoint(XCoordinate=Slider(0, range=0..20), YCoordinate=Slider(0, range=0..10), ZCoordinate=Slider(0, range=0..20))
num = Number(0)
num_2 = Number(0)
intcrv = Interpolate(Vertices=[pt_4, pt, pt_2, pt_3], Degree=3, Periodic=False, KnotStyle=1)  # -> Curve, Length, Domain
vec = VectorXYZ(XComponent=num_2, YComponent=Slider(10, range=0..100), ZComponent=num)  # -> Vector, Length
vdis = VectorDisplay(Anchor=Point(0, 0.0006274138079, -0.0006274138079), Vector=vec.Vector)
arrlinear = LinearArray(Geometry=intcrv.Curve, Direction=vec.Vector, Count=Slider(10, range=0..100))  # -> Geometry, Transform
loft = Loft(
    Curves=arrlinear.Geometry,
    Options={Adjust=False, Closed=False, LoftEnds=0, LoftSimp=0, LoftType=0, Rebuild=10, Refit=0.01})

crv = Curve(arrlinear.Geometry)
cp = ControlPoints(Curve=crv)  # -> Points, Weights, Knots
