# Grasshopper definition parametric_bench.gh (Grasshopper 1.0.7)

pt = ConstructPoint(XCoordinate=Slider(5, range=0..20), YCoordinate=Slider(0, range=0..10), ZCoordinate=Slider(10, range=0..20))
pt_2 = ConstructPoint(XCoordinate=Slider(15, range=0..20), YCoordinate=Slider(0, range=0..10), ZCoordinate=Slider(8, range=0..20))
pt_3 = ConstructPoint(XCoordinate=Slider(20, range=0..20), YCoordinate=Slider(0, range=0..10), ZCoordinate=Slider(20, range=0..20))
pt_4 = ConstructPoint(XCoordinate=Slider(0, range=0..20), YCoordinate=Slider(0, range=0..10), ZCoordinate=Slider(0, range=0..20))
num = Number(0)
num_2 = Number(0)
intcrv = Interpolate(Vertices=[pt_4, pt, pt_2, pt_3], Degree=3, Periodic=False, KnotStyle=1)  # -> Curve, Length, Domain
vec = VectorXYZ(XComponent=num_2, YComponent=Slider(10, range=0..100), ZComponent=num)  # -> Vector, Length
vdis = VectorDisplay(Anchor=Point(0, 0.0006274138079, -0.0006274138079), Vector=vec.Vector)
arrlinear = LinearArray(Geometry=intcrv.Curve, Direction=vec.Vector, Count=Slider(10, range=0..100))  # -> Geometry, Transform
loft = Loft(
    Curves=arrlinear.Geometry,
    Options={Adjust=False, Closed=False, LoftEnds=0, LoftSimp=0, LoftType=0, Rebuild=10, Refit=0.01})

crv = Curve(arrlinear.Geometry)

wheel = ColourWheel(
    Slider(2, range=1..3),
    ColourGrips_Style=21,
    ColourGrips_Grip=[0.9097533803, 4.051346034, 2.480549707, 5.622142361],
    ColourGrips_Lum=[0.1, 0.9219518979],
    ColourGrips_Range=[0.4170250156, 0.4170250156, 0.4170250156, 0.4170250156],
    ColourGrips_Sat=[0.2, 0.3982991259])
material = CreateMaterial(Diffuse=wheel, Specular=wheel, Emission=wheel, Transparency=0, Shine=0)

num_3 = Number(Slider(2, range=0..4))
brep = Brep(<brep referenced from the Rhino model>)
contour = Contour(
    Shape=brep,
    Point=Point(0, 0.0006274138079, -0.0006274138079),
    Direction=Vector(0, 45.00062741, -0.0006274138079),
    Distance=num_3)
num_4 = Number(0)
num_5 = Number(0)
vec_2 = VectorXYZ(XComponent=num_5, YComponent=Slider(1, range=0..4), ZComponent=num_4)  # -> Vector, Length
vdis_2 = VectorDisplay(Anchor=Point(0, 0.0006274138079, -0.0006274138079), Vector=vec_2.Vector)
extr = Extrude(Base=contour, Direction=vec_2.Vector)
cap = CapHoles(Brep=extr)
preview = CustomPreview(Geometry=cap, Material=material)

cp = ControlPoints(Curve=crv)  # -> Points, Weights, Knots
