# Grasshopper definition sine_bench.gh (Grasshopper 1.0.7)

number_slider = Slider(2, range=0..12)

pi = Pi(Factor=Slider(1, range=0..12))
dom = ConstructDomain(DomainStart=0, DomainEnd=pi)
range = Range(Domain=dom, Steps=Slider(360, range=0..360))
expression = Expression(w=graft([Slider(1, range=0..2), Slider(0.5, range=0..2), Slider(1.5, range=0..2)]), t=range, Expression="sin(w*t)")

pt = ConstructPoint(XCoordinate=range, YCoordinate=expression, ZCoordinate=0)
intcrv = Interpolate(Vertices=pt, Degree=3, Periodic=False, KnotStyle=1)  # -> Curve, Length, Domain

multiplication = Multiplication(A=number_slider, B=number_slider)
multiplication_2 = Multiplication(A=multiplication, B=number_slider)
vec = VectorXYZ(XComponent=0, YComponent=0, ZComponent=graft([number_slider, multiplication, multiplication_2]))  # -> Vector, Length
move = Move(Geometry=intcrv.Curve, Motion=vec.Vector)  # -> flatten(Geometry), Transform

loft = Loft(Curves=move.Geometry, Options={Adjust=False, Closed=False, LoftEnds=0, LoftSimp=0, LoftType=0, Rebuild=10, Refit=0.01})
rot3d = Rotate3D(Geometry=loft, Angle=1.570796327, Center=Point(0, 0, 0), Axis=Vector(9, 0, 0))  # -> Geometry, Transform

contour = Contour(
    Shape=rot3d.Geometry,
    Point=Point(0, 0.0006274138079, -0.0006274138079),
    Direction=Vector(0, 45.00062741, -0.0006274138079),
    Distance=Slider(0.5, range=0..4))
vec_2 = VectorXYZ(XComponent=0, YComponent=Slider(0.25, range=0..4), ZComponent=0)  # -> Vector, Length
extr = Extrude(Base=contour, Direction=vec_2.Vector)
vdis = VectorDisplay(Anchor=Point(0, 0.0006274138079, -0.0006274138079), Vector=vec_2.Vector)
vec_3 = VectorXYZ(XComponent=0, YComponent=0, ZComponent=Slider(1, range=0..1))  # -> Vector, Length
extr_2 = Extrude(Base=extr, Direction=vec_3.Vector)
