# Grasshopper definition sine_functions.gh (Grasshopper 1.0.7)

pi = Pi(Factor=Slider(2, range=0..12))
dom = ConstructDomain(DomainStart=0, DomainEnd=pi)
range = Range(Domain=dom, Steps=Slider(22, range=0..360))
expression = Expression(w=Slider(2, range=0..2), t=range, Expression="sin(w*t)")
pt = ConstructPoint(XCoordinate=range, YCoordinate=expression, ZCoordinate=0)
intcrv = Interpolate(Vertices=pt, Degree=3, Periodic=False, KnotStyle=1)  # -> Curve, Length, Domain

pi_2 = Pi(Factor=Slider(2, range=0..12))
dom_2 = ConstructDomain(DomainStart=0, DomainEnd=pi_2)
range_2 = Range(Domain=dom_2, Steps=Slider(22, range=0..360))
multiplication = Multiplication(A=Slider(1, range=0..2), B=range_2)
sin = Sine(Value=multiplication)
pt_2 = ConstructPoint(XCoordinate=multiplication, YCoordinate=sin, ZCoordinate=0)
intcrv_2 = Interpolate(Vertices=pt_2, Degree=3, Periodic=False, KnotStyle=1)  # -> Curve, Length, Domain

# ----
# shift click and drag to
# connect sliders to grafted w
number_slider = Slider(2, range=0..12)
pi_3 = Pi(Factor=number_slider)
dom_3 = ConstructDomain(DomainStart=0, DomainEnd=pi_3)
range_3 = Range(Domain=dom_3, Steps=Slider(360, range=0..360))
panel = Panel("graft w")
expression_2 = Expression(w=graft([Slider(2, range=0..2), Slider(1, range=0..2), Slider(0.5, range=0..2)]), t=range_3, Expression="sin(w*t)")
pt_3 = ConstructPoint(XCoordinate=range_3, YCoordinate=expression_2, ZCoordinate=0)
intcrv_3 = Interpolate(Vertices=pt_3, Degree=3, Periodic=False, KnotStyle=1)  # -> Curve, Length, Domain

pi_4 = Pi(Factor=Slider(2, range=0..12))
dom_4 = ConstructDomain(DomainStart=0, DomainEnd=pi_4)
range_4 = Range(Domain=dom_4, Steps=Slider(360, range=0..360))
expression_3 = Expression(w=graft([Slider(1, range=0..2), Slider(0.5, range=0..2), Slider(0.25, range=0..2)]), t=range_4, Expression="sin(w*t)")
panel_2 = Panel("flip matrix")
panel_3 = Panel("""mass addition
& multiplication""")

viewer = ParamViewer(expression_3)
flip = FlipMatrix(Data=expression_3)
ma = MassMultiplication(Input=flip)  # -> Result, PartialResults
ma_2 = MassAddition(Input=flip)  # -> Result, PartialResults
viewer_2 = ParamViewer(flip)

pt_4 = ConstructPoint(XCoordinate=range_4, YCoordinate=flatten(ma.Result), ZCoordinate=0)
intcrv_4 = Interpolate(Vertices=pt_4, Degree=3, Periodic=False, KnotStyle=1)  # -> Curve, Length, Domain

pt_5 = ConstructPoint(XCoordinate=range_4, YCoordinate=flatten(ma_2.Result), ZCoordinate=0)
intcrv_5 = Interpolate(Vertices=pt_5, Degree=3, Periodic=False, KnotStyle=1)  # -> Curve, Length, Domain

vec = VectorXYZ(XComponent=0, YComponent=0, ZComponent=Slider(4, range=0..12))  # -> Vector, Length
move = Move(Geometry=intcrv_5.Curve, Motion=vec.Vector)  # -> Geometry, Transform
merge = Merge(Data1=intcrv_4.Curve, Data2=move.Geometry)
loft = Loft(Curves=merge, Options={Adjust=False, Closed=False, LoftEnds=0, LoftSimp=0, LoftType=0, Rebuild=10, Refit=0.01})
