# Grasshopper definition sine_surface.gh (Grasshopper 1.0.7)

number_slider = Slider(2, range=0..12)

pi = Pi(Factor=Slider(2, range=0..12))
dom = ConstructDomain(DomainStart=0, DomainEnd=pi)
range = Range(Domain=dom, Steps=Slider(360, range=0..360))
expression = Expression(w=graft([Slider(2, range=0..2), Slider(1, range=0..2), Slider(0.5, range=0..2)]), t=range, Expression="sin(w*t)")

pt = ConstructPoint(XCoordinate=range, YCoordinate=expression, ZCoordinate=0)
intcrv = Interpolate(Vertices=pt, Degree=3, Periodic=False, KnotStyle=1)  # -> Curve, Length, Domain

multiplication = Multiplication(A=number_slider, B=number_slider)
multiplication_2 = Multiplication(A=multiplication, B=number_slider)
vec = VectorXYZ(XComponent=0, YComponent=0, ZComponent=graft([number_slider, multiplication, multiplication_2]))  # -> Vector, Length
move = Move(Geometry=intcrv.Curve, Motion=vec.Vector)  # -> flatten(Geometry), Transform

loft = Loft(Curves=move.Geometry, Options={Adjust=False, Closed=False, LoftEnds=0, LoftSimp=0, LoftType=0, Rebuild=10, Refit=0.01})
